# Dynamo graph Reposicionar_Paineis_Acústicos_2024.dyn (Dynamo 2.17.0.3472)

# group: Ajuste de Angulos e Alturas dos paineis
# Desenvolvida por Prof. José Luis Menegotto
# Escola Politécnica UFRJ - Departamento de Expressão Gráfica
family_types = FamilyTypes("Painel_Acustico:Painel 1m")  # graph input
muda_angulo = DoubleSlider(20, range=-90..90 step 5)  # graph input
muda_altura = DoubleSlider(3.25, range=1..10 step 0.25)  # graph input
reposicionamento_de_paineis = CodeBlock(TipPainel=family_types, novoangu=muda_angulo, novaaltu=muda_altura)  # "Reposicionamento de paineis acústicos 2024"
# ---------- reposicionamento_de_paineis.designscript (6 lines) ----------
TipPainel;
novoangu;
novaaltu;
P = FamilyInstance.ByFamilyType(TipPainel);
P.SetParameterByName( "Angulo" , novoangu * -1);
P.SetParameterByName( "Altura" , novaaltu);
# ----------------------------------------

# group: Ajuste Paineis do Teto
# Desenvolvida por Prof. José Luis Menegotto
# Escola Politécnica UFRJ - Departamento de Expressão Gráfica
family_types_2 = FamilyTypes("Painel_Acustico:Painel 1m")  # graph input
muda_angulo_2 = DoubleSlider(35, range=20..60 step 5)  # graph input
altura = DoubleSlider(-2.75, range=-3.5..-1.5 step 0.25)  # graph input
rotaciona_paineos_teto_2024 = CodeBlock(TipPainel=family_types_2, novaalt=muda_angulo_2, novoang=altura)
# ---------- rotaciona_paineos_teto_2024.designscript (6 lines) ----------
TipPainel;
novaalt;
novoang;
P = FamilyInstance.ByFamilyType (TipPainel);
P.SetParameterByName ( "Painel_Angulo", novoang);
P.SetParameterByName ( "Offset"       , novaalt);
# ----------------------------------------
